% Simulink data dictionary SharedData.sldd

PWMFrequency = Simulink.Parameter(490, Unit="Hz")
Run_on_Hardware_Configuration = Simulink.ConfigSet(StartTime="0", StopTime="10", Solver="ode3", ProdHWDeviceType="Atmel->AVR", SystemTargetFile="ert.tlc", HardwareBoard="Arduino Mega 2560", TargetLang="C")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